# Grasshopper definition circles_outer surfs.gh (Grasshopper 0.9.76)
# Copyright: Co-de-iT
# plug-ins: Human, Kangaroo Components

srf = Surface(reparameterize(<surface referenced from the Rhino model>))
mesh = Mesh(<mesh referenced from the Rhino model>)
mesh_2 = Mesh(<mesh referenced from the Rhino model>)
tangentcircles = TangentCircles(mesh=mesh_2)  # -> C, flatten(P)
demesh = DeconstructMesh(Mesh=mesh_2)  # -> Vertices, Faces, Colours, Normals
Y = UnitY(Factor="100")
nv = NakedVertices(Mesh=mesh_2)  # -> ClothedIndex, NakedIndex, ClothedPts, NakedPts
deplane = DeconstructPlane(Plane=tangentcircles.P)  # -> Origin, XAxis, YAxis, ZAxis
deface = DeconstructFace(Face=demesh.Faces)  # -> graft(CornerA), graft(CornerB), graft(CornerC), graft(CornerD)
move = Move(Geometry=srf, Motion=Y)  # -> Geometry, Transform
merge = Merge(Data1=deface.CornerA, Data2=deface.CornerB, Data3=deface.CornerC, Data4=deface.CornerD)
srf_cp = SurfaceClosestPoint(Point=demesh.Vertices, Surface=move.Geometry)  # -> Point, UVPoint, Distance
item = ListItem(List=demesh.Vertices, Index=merge, Wrap=True)
shift = ShiftList(List=item, Shift=2, Wrap=True)
curvature = SurfaceCurvature(Surface=move.Geometry, Point=srf_cp.UVPoint)  # -> Frame, Gaussian, Mean
item_2 = ListItem(List=item, Index=0, Wrap=True)  # -> Item, Item1, Item2
item_3 = ListItem(List=shift, Index=0, Wrap=True)  # -> Item, Item1, Item2
bnd = Bounds(Numbers=curvature.Gaussian)
remap = RemapNumbers(Value=curvature.Gaussian, Source=bnd, Target=Domain(0, 1))  # -> Mapped, Clipped
ln = Line(StartPoint=item_2.Item, EndPoint=item_3.Item)
ln_2 = Line(StartPoint=item_2.Item1, EndPoint=item_3.Item1)
ln_3 = Line(StartPoint=item_2.Item2, EndPoint=item_3.Item2)
graph = GraphMapper(remap.Mapped, x0=0, x1=1, y0=0, y1=1, container_name="Bezier", cpx=[0, 0.4052186012, 0.5675367117, 1], cpy=[0, 0, 1, 1])

# ----
# thickness regulation
number_slider = Slider(1.619, range=0..5)
dom = ConstructDomain(DomainStart=number_slider, DomainEnd=Slider(0.6, range=0..5))
remap_2 = RemapNumbers(Value=graph, Source=Domain(0, 1), Target=dom)  # -> Mapped, Clipped

eval = EvaluateCurve(Curve=ln_2)  # -> Point, Tangent, Angle
eval_2 = EvaluateCurve(Curve=ln_3)  # -> Point, Tangent, Angle
eval_3 = EvaluateCurve(Curve=ln)  # -> Point, Tangent, Angle
gradient = Gradient(LowerLimit=0, UpperLimit=1, Parameter=remap.Mapped, stops=[0: RGB(255, 255, 255), 1: RGB(0, 0, 0)])
item_4 = ListItem(List=graph, Index=nv.ClothedIndex, Wrap=True)
dom_2 = ConstructDomain(DomainStart=Slider(0.322, range=0.001..1), DomainEnd=Slider(0.466, range=0.001..1))
remap_3 = RemapNumbers(Value=item_4, Source=Domain(0, 1), Target=dom_2)  # -> Mapped, Clipped
conmesh = ConstructMesh(Vertices=demesh.Vertices, Faces=demesh.Faces, Colours=gradient)
scale = Scale(Geometry=tangentcircles.C, Center=tangentcircles.P, Factor=remap_3.Mapped)  # -> Geometry, Transform
scale_2 = Scale(Geometry=tangentcircles.C, Center=tangentcircles.P, Factor=Slider(0.9, range=0.001..1))  # -> Geometry, Transform
rev = Reverse(Vector=deplane.ZAxis)
item_5 = ListItem(List=remap_2.Mapped, Index=nv.ClothedIndex, Wrap=True)
rev_2 = Reverse(Vector=demesh.Normals)
multiplication = Multiplication(A=remap_2.Mapped, B=2)
amp = Amplitude(Vector=rev, Amplitude=item_5)
amp_2 = Amplitude(Vector=rev_2, Amplitude=multiplication)
move_2 = Move(Geometry=demesh.Vertices, Motion=amp_2)  # -> Geometry, Transform

# ---- group: lower mesh
conmesh_2 = ConstructMesh(Vertices=move_2.Geometry, Faces=demesh.Faces)

# ----
medges = MeshEdges(Mesh=mesh_2)  # -> NakedEdges, InteriorEdges, NonManifoldEdges
medges_2 = MeshEdges(Mesh=conmesh_2)  # -> NakedEdges, InteriorEdges, NonManifoldEdges
curvepoint = PointOnCurve(medges_2.InteriorEdges, parameter=0.5)
curvepoint_2 = PointOnCurve(medges.InteriorEdges, parameter=0.5)
cp = ClosestPoint(Point=curvepoint_2, Cloud=curvepoint)  # -> ClosestPoint, CPIndex, Distance
item_6 = ListItem(List=medges_2.InteriorEdges, Index=cp.CPIndex, Wrap=True)
merge_2 = Merge(Data1=simplify(graft(medges.InteriorEdges)), Data2=simplify(graft(item_6)))
loft = Loft(Curves=merge_2, Options={Adjust=False, Closed=False, LoftEnds=0, LoftSimp=0, LoftType=0, Rebuild=10, Refit=0.01})
previewmat = CustomPreviewMaterials(Geometry=loft, DiffuseColor=RGB(255, 255, 255))

tangentcircles_2 = TangentCircles(mesh=conmesh_2)  # -> C, flatten(P)
scale_3 = Scale(Geometry=tangentcircles_2.C, Center=tangentcircles_2.P, Factor=Slider(0.9, range=0.001..1))  # -> Geometry, Transform
move_3 = Move(Geometry=scale.Geometry, Motion=amp)  # -> Geometry, Transform
merge_3 = Merge(Data1=simplify(graft(scale_2.Geometry)), Data2=simplify(graft(move_3.Geometry)))
merge_4 = Merge(Data1=simplify(graft(scale_3.Geometry)), Data2=simplify(graft(move_3.Geometry)))
loft_2 = Loft(Curves=merge_3, Options={Adjust=False, Closed=False, LoftEnds=0, LoftSimp=0, LoftType=0, Rebuild=10, Refit=0.01})
loft_3 = Loft(Curves=merge_4, Options={Adjust=False, Closed=False, LoftEnds=0, LoftSimp=0, LoftType=0, Rebuild=10, Refit=0.01})

# ==== cluster TangentCircles: A compact circle packing from a flat mesh
mesh = ClusterInput()
mesh_2 = Mesh(mesh)
nv = NakedVertices(Mesh=mesh_2)  # -> ClothedIndex, NakedIndex, ClothedPts, NakedPts
vn = VertexNeighbours(Mesh=mesh_2, VertexNumber=nv.ClothedIndex)  # -> graft(Vertex), Neighbours, Normal
item = ListItem(List=vn.Neighbours, Index=0, Wrap=True)  # -> Item, Item1
dist = Distance(PointA=item.Item, PointB=item.Item1)
dist_2 = Distance(PointA=vn.Vertex, PointB=[item.Item, item.Item1])
ma = MassAddition(Input=[dist_2, dist])  # -> Result, PartialResults
multiplication = Multiplication(A=ma.Result, B=0.5)
pl = PlaneNormal(Origin=vn.Vertex, ZAxis=graft(vn.Normal))
subtraction = Subtraction(A=multiplication, B=dist)
cir = Circle(Plane=pl, Radius=subtraction)  # -> flatten(Circle)
C = ClusterOutput(cir)
P = ClusterOutput(pl)
