# Grasshopper definition Relief final geometry 20160514.gh (Grasshopper 0.9.76)
# plug-ins: Heteroptera, Unroller, Human

shorten = Slider(0, range=0..0.4)
subtraction = Subtraction(A=1, B=shorten)
dom = ConstructDomain(DomainStart=shorten, DomainEnd=subtraction)
# curves_right
crv = Curve(reparameterize([<curve referenced from the Rhino model> x2]))
# curves_left
crv_2 = Curve(reparameterize([<curve referenced from the Rhino model> x2]))
sampling = Slider(20, range=2..200)
fill_curves = Slider(4, range=2..50)

# ---- group: medial axis
crv_3 = Curve(<curve referenced from the Rhino model>)

# ---- group: surface for Z regulation
srf = Surface(<surface referenced from the Rhino model>)

# ----
subcrv = SubCurve(BaseCurve=crv, Domain=dom)
subcrv_2 = SubCurve(BaseCurve=crv_2, Domain=dom)
divide = DivideCurve(Curve=subcrv_2, Count=sampling, Kinks=False)  # -> Points, Tangents, Parameters
flip = FlipMatrix(Data=divide.Points)
pline = PolyLine(Vertices=flip, Closed=False)
divide_2 = DivideCurve(Curve=subcrv, Count=sampling, Kinks=False)  # -> Points, Tangents, Parameters
explode = Explode(Curve=pline, Recursive=True)  # -> Segments, Vertices
flip_2 = FlipMatrix(Data=divide_2.Points)

number_slider = Slider(0.21, range=0..1)  # disabled
crv_4 = Curve(reparameterize(<curve referenced from the Rhino model>))  # disabled
eval = EvaluateCurve(Curve=crv_4, Parameter=number_slider)  # -> Point, Tangent, Angle; disabled
number_slider_2 = Slider(10, range=0..30)  # disabled
divide_3 = DivideCurve(Curve=crv_4, Count=number_slider_2, Kinks=False)  # -> Points, Tangents, Parameters; disabled
vec2pt = Vector2Pt(PointA=flip, PointB=eval.Point, Unitize=False)  # -> Vector, Length; disabled
vdis = VectorDisplay(Anchor=divide_3.Points, Vector=vec2pt.Vector)  # disabled

divide_4 = DivideCurve(Curve=explode.Segments, Count=fill_curves, Kinks=False)  # -> Points, Tangents, Parameters
pline_2 = PolyLine(Vertices=flip_2, Closed=False)
pshift = ShiftPaths(Data=divide_4.Points, Offset=-1)
number_slider_3 = Slider(-16.1, range=-30..0)
number_slider_4 = Slider(-0.161, range=-2..0.001)
number_slider_5 = Slider(-1, range=-100..0)
explode_2 = Explode(Curve=pline_2, Recursive=True)  # -> Segments, Vertices
flip_3 = FlipMatrix(Data=pshift)
lng = ListLength(List=flip_3)  # -> expr("x-1", Length)
range = Range(Domain=Domain(0, 1), Steps=lng)
graph = GraphMapper(range, x0=0, x1=1, y0=0, y1=1, container_name="Sine", Equation_px=[0, 0.5223546624], Equation_py=[0.1705827117, 1])
divide_5 = DivideCurve(Curve=explode_2.Segments, Count=fill_curves, Kinks=False)  # -> Points, Tangents, Parameters
number_slider_6 = Slider(-0.161, range=-2..0.001)
pshift_2 = ShiftPaths(Data=divide_5.Points, Offset=-1)
multiplication = Multiplication(A=graph, B=number_slider_3)
number_slider_7 = Slider(-1, range=-100..0)
flip_4 = FlipMatrix(Data=pshift_2)
lng_2 = ListLength(List=flip_4)  # -> expr("x-1", Length)
range_2 = Range(Domain=Domain(0, 1), Steps=lng_2)
graph_2 = GraphMapper(range_2, x0=0, x1=1, y0=0, y1=1, container_name="Sine", Equation_px=[0, 0.5223546624], Equation_py=[0.1705827117, 1])
Z = UnitZ(Factor=multiplication)
move = Move(Geometry=flip_3, Motion=Z)  # -> Geometry, Transform
multiplication_2 = Multiplication(A=graph_2, B=number_slider_3)
Z_2 = UnitZ(Factor=multiplication_2)
intcrv = Interpolate(Vertices=flip_3, Degree=3, Periodic=False, KnotStyle=1)  # -> flatten(Curve), Length, Domain
intcrv_2 = Interpolate(Vertices=move.Geometry, Degree=3, Periodic=False, KnotStyle=1)  # -> flatten(Curve), Length, Domain
move_2 = Move(Geometry=flip_4, Motion=Z_2)  # -> Geometry, Transform
intcrv_3 = Interpolate(Vertices=flip_4, Degree=3, Periodic=False, KnotStyle=1)  # -> flatten(Curve), Length, Domain
intcrv_4 = Interpolate(Vertices=move_2.Geometry, Degree=3, Periodic=False, KnotStyle=1)  # -> Curve, Length, Domain
srf_2 = Surface(<surface referenced from the Rhino model>)
divide_6 = DivideCurve(Curve=intcrv_3.Curve, Count=10, Kinks=False)  # -> Points, Tangents, Parameters
Z_3 = UnitZ(Factor=1)
Z_4 = UnitZ(Factor=-1)
project = Project(Curve=intcrv_4.Curve, Brep=srf, Direction=Z_3)
Z_5 = UnitZ(Factor=1)
line = LineSDL(Start=divide_6.Points, Direction=Z_4, Length="100")
divide_7 = DivideCurve(Curve=intcrv.Curve, Count=10, Kinks=False)  # -> Points, Tangents, Parameters
Z_6 = UnitZ(Factor=-1)
scx = SurfaceCurve(Surface=srf, Curve=line)  # -> Curves, Points, UVPoints, Normals, Parameters, Tangents
project_2 = Project(Curve=intcrv_2.Curve, Brep=srf_2, Direction=Z_5)
line_2 = LineSDL(Start=divide_7.Points, Direction=Z_6, Length="100")
pshift_3 = ShiftPaths(Data=scx.Points, Offset=-1)
scx_2 = SurfaceCurve(Surface=srf, Curve=line_2)  # -> Curves, Points, UVPoints, Normals, Parameters, Tangents
pshift_4 = ShiftPaths(Data=scx_2.Points, Offset=-1)
nurbs = NurbsCurve(Vertices=pshift_4, Degree=3, Periodic=False)  # -> Curve, Length, Domain
divide_8 = DivideCurve(Curve=nurbs.Curve, Count=10, Kinks=False)  # -> Points, Tangents, Parameters
int = Integer(fill_curves)
nurbs_2 = NurbsCurve(Vertices=pshift_3, Degree=3, Periodic=False)  # -> Curve, Length, Domain
flip_5 = FlipMatrix(Data=divide_8.Points)
int_2 = Integer(fill_curves)
merge = Merge(Data1="0", Data2=int)
merge_2 = Merge(Data1="0", Data2=int_2)
toggle = BooleanToggle(False)
toggle_2 = BooleanToggle(False)
divide_9 = DivideCurve(Curve=nurbs_2.Curve, Count=10, Kinks=False)  # -> Points, Tangents, Parameters
replace = ReplaceItems(List=intcrv.Curve, Item=subcrv_2, Indices=merge, Wrap=False)  # -> flatten(List)
replace_2 = ReplaceItems(List=intcrv_3.Curve, Item=subcrv, Indices=merge_2, Wrap=False)  # -> flatten(List)
flip_6 = FlipMatrix(Data=divide_9.Points)
shift = ShiftList(List=flip_6, Shift="1", Wrap=toggle)  # -> graft(List)
shift_2 = ShiftList(List=flip_5, Shift="1", Wrap=toggle_2)  # -> graft(List)
shift_3 = ShiftList(List=flip_6, Shift="-1", Wrap=toggle)  # -> graft(List)
shift_4 = ShiftList(List=flip_5, Shift="-1", Wrap=toggle_2)  # -> graft(List)
number_slider_8 = Slider(69, range=0..100)

# ---- group: top curves - right
crv_5 = Curve(reparameterize(intcrv_3.Curve))

# ---- group: top curves - left
crv_6 = Curve(reparameterize(intcrv.Curve))

# ----
avr = Average(Input=[shift, shift_3])
avr_2 = Average(Input=[shift_2, shift_4])
vec2pt_2 = Vector2Pt(PointA=shift_3, PointB=shift, Unitize=False)  # -> Vector, Length
crv_cp = CurveClosestPoint(Point=avr, Curve=crv_3)  # -> Point, Parameter, Distance
crv_cp_2 = CurveClosestPoint(Point=avr_2, Curve=crv_3)  # -> Point, Parameter, Distance
vec2pt_3 = Vector2Pt(PointA=shift_4, PointB=shift_2, Unitize=False)  # -> Vector, Length
number_slider_9 = Slider(0.475, range=0..1)
bar_graph = BarGraph(crv_cp.Distance, BarColor=RGB(255, 0, 90))
bar_graph_2 = BarGraph(crv_cp_2.Distance, BarColor=RGB(255, 0, 90))
panel = Panel("""0
-1""")
# connectors
panel_2 = Panel("""0
-1""")
min = Minimum(A=crv_cp.Distance, B=number_slider_8)
min_2 = Minimum(A=crv_cp_2.Distance, B=number_slider_8)
item = ListItem(List=crv_5, Index=-1, Wrap=True)
cull_i = CullIndex(List=crv_6, Indices=panel, Wrap=True)
cull_i_2 = CullIndex(List=crv_5, Indices=panel_2, Wrap=True)
bnd = Bounds(Numbers=flatten(min))
bnd_2 = Bounds(Numbers=flatten(min_2))
eval_2 = EvaluateCurve(Curve=crv_5, Parameter=number_slider_9)  # -> Point, Tangent, Angle
item_2 = ListItem(List=crv_6, Index=0, Wrap=True)
dom_2 = ConstructDomain(DomainStart=0, DomainEnd=Slider(0.6, range=0..1))
dom_3 = ConstructDomain(DomainStart=0, DomainEnd=Slider(0.6, range=0..1))
toggle_3 = BooleanToggle(False)
toggle_4 = BooleanToggle(False)
item_3 = ListItem(List=eval_2.Point, Index=-1, Wrap=True)
crv_cp_3 = CurveClosestPoint(Point=item_3, Curve=item_2)  # -> Point, Parameter, Distance
remap = RemapNumbers(Value=min_2, Source=bnd_2, Target=dom_3)  # -> Mapped, Clipped
multiplication_3 = Multiplication(A=vec2pt_3.Vector, B=remap.Clipped)
remap_2 = RemapNumbers(Value=min, Source=bnd, Target=dom_2)  # -> Mapped, Clipped
multiplication_4 = Multiplication(A=vec2pt_2.Vector, B=remap_2.Clipped)
shatter = Shatter(Curve=cull_i_2, Parameters=number_slider_9)
multiplication_5 = Multiplication(A=multiplication_3, B=-1)
move_3 = Move(Geometry=avr, Motion=multiplication_4)  # -> Geometry, Transform
vdisex = VectorDisplayEx(Point=avr, Vector=multiplication_4, Colour=RGB(0, 0, 0), Width=2)
move_4 = Move(Geometry=avr_2, Motion=multiplication_5)  # -> Geometry, Transform
shatter_2 = Shatter(Curve=cull_i, Parameters=crv_cp_3.Parameter)
shift_5 = ShiftList(List=crv_6, Shift="1", Wrap=toggle_4)  # -> simplify(graft(List))
shift_6 = ShiftList(List=crv_5, Shift="1", Wrap=toggle_3)  # -> simplify(graft(List))
shift_7 = ShiftList(List=crv_5, Shift="-1", Wrap=toggle_3)  # -> simplify(graft(List))
shift_8 = ShiftList(List=crv_6, Shift="-1", Wrap=toggle_4)  # -> simplify(graft(List))
vdisex_2 = VectorDisplayEx(Point=avr_2, Vector=multiplication_5, Colour=RGB(0, 0, 0), Width=2)
dispatch = Dispatch(List=shatter, DispatchPattern=[True, False])  # -> ListA, ListB
pshift_5 = ShiftPaths(Data=move_3.Geometry, Offset=-1)  # -> simplify(Data)
pshift_6 = ShiftPaths(Data=move_4.Geometry, Offset=-1)  # -> simplify(Data)
flip_7 = FlipCurve(Curve=dispatch.ListA)  # -> Curve, Flag
flip_8 = FlipMatrix(Data=pshift_5)
flip_9 = FlipMatrix(Data=pshift_6)
dispatch_2 = Dispatch(List=shatter_2, DispatchPattern=[True, False])  # -> ListA, ListB
number_slider_10 = Slider(0.5, range=0..1)

# ---- group: bottom curves
intcrv_5 = Interpolate(Vertices=flip_9, Degree=3, Periodic=False, KnotStyle=1)  # -> simplify(graft(Curve)), Length, Domain

intcrv_6 = Interpolate(Vertices=flip_8, Degree=3, Periodic=False, KnotStyle=1)  # -> simplify(graft(Curve)), Length, Domain

# ----
flip_10 = FlipCurve(Curve=dispatch_2.ListA)  # -> Curve, Flag
weave = Weave(Pattern=[0, 1], Stream0=dispatch.ListB, Stream1=flip_7.Curve, NullGaps=False)
len = Length(Curve=weave)
weave_2 = Weave(Pattern=[0, 1], Stream0=dispatch_2.ListB, Stream1=flip_10.Curve, NullGaps=False)
division = Division(A=len, B=number_slider_10)
range_3 = Range(Domain=Domain(0, 1), Steps=Slider(5, range=2..8))
# left
# top surf
loft = Loft(
    Curves=[shift_5, shift_8],
    Options={Adjust=False, Closed=False, LoftEnds=0, LoftSimp=0, LoftType=0, Rebuild=10, Refit=0.01})
# right surf
loft_2 = Loft(
    Curves=[shift_8, intcrv_5.Curve],
    Options={Adjust=False, Closed=False, LoftEnds=0, LoftSimp=0, LoftType=0, Rebuild=10, Refit=0.01})
# left surf
loft_3 = Loft(
    Curves=[shift_5, intcrv_5.Curve],
    Options={Adjust=False, Closed=False, LoftEnds=0, LoftSimp=0, LoftType=0, Rebuild=10, Refit=0.01})
# left surf
loft_4 = Loft(
    Curves=[shift_6, intcrv_6.Curve],
    Options={Adjust=False, Closed=False, LoftEnds=0, LoftSimp=0, LoftType=0, Rebuild=10, Refit=0.01})
# right surf
loft_5 = Loft(
    Curves=[shift_7, intcrv_6.Curve],
    Options={Adjust=False, Closed=False, LoftEnds=0, LoftSimp=0, LoftType=0, Rebuild=10, Refit=0.01})
# right
# top surf
loft_6 = Loft(
    Curves=[shift_6, shift_7],
    Options={Adjust=False, Closed=False, LoftEnds=0, LoftSimp=0, LoftType=0, Rebuild=10, Refit=0.01})
int_3 = Integer(division)
cull_i_3 = CullIndex(List=range_3, Indices=-1, Wrap=True)
divlength = DivideLength(Curve=weave_2, Length=number_slider_10)  # -> Points, Tangents, Parameters
divlength_2 = DivideLength(Curve=weave, Length=number_slider_10)  # -> Points, Tangents, Parameters
merge_3 = Merge(Data1=loft, Data2=loft_3, Data3=loft_2)
merge_4 = Merge(Data1=loft_6, Data2=loft_4, Data3=loft_5)
graph_3 = GraphMapper(
    cull_i_3,
    x0=0,
    x1=1,
    y0=0,
    y1=1,
    container_name="Bezier",
    cpx=[0, 0.2869572341, 0.6637688279, 1],
    cpy=[0, 0.4768119454, 0.9695655704, 1])
number_slider_11 = Slider(0.03, range=0..1)
previewmat = CustomPreviewMaterials(Geometry=merge_3, DiffuseColor=RGB(255, 255, 255))
previewmat_2 = CustomPreviewMaterials(Geometry=merge_4, DiffuseColor=RGB(255, 255, 255))
pframe = PerpFrame(Curve=reparameterize(graft(weave)), Parameter=graph_3)
pframe_2 = PerpFrame(Curve=reparameterize(graft(weave_2)), Parameter=graph_3)
eval_3 = EvaluateCurve(Curve=reparameterize(graft(weave)), Parameter=graph_3)  # -> Point, Tangent, Angle
eval_4 = EvaluateCurve(Curve=reparameterize(graft(weave_2)), Parameter=graph_3)  # -> Point, Tangent, Angle
Z_7 = UnitZ(Factor=1)
subtraction_2 = Subtraction(A="1", B=number_slider_11)
dam = DataDam(DataA=merge_3, BufferDelay=10000000, BufferMode=0)
item_4 = ListItem(List=crv_6, Index=0, Wrap=True)
dam_2 = DataDam(DataA=merge_4, BufferDelay=10000000, BufferMode=0)
align = AlignPlane(Plane=pframe, Direction=Z_7)  # -> Plane, Angle
align_2 = AlignPlane(Plane=pframe_2, Direction=Z_7)  # -> Plane, Angle
merge_5 = Merge(Data1=number_slider_11, Data2=subtraction_2)
pframe_3 = PerpFrame(Curve=reparameterize(graft(item_4)), Parameter=merge_5)
unroller = Unroller(Brep=dam)  # -> Brep, Curves, Points
pframe_4 = PerpFrame(Curve=item, Parameter=number_slider_9)
unroller_2 = Unroller(Brep=dam_2)  # -> Brep, Curves, Points
pshift_7 = ShiftPaths(Data=align_2.Plane, Offset=-1)
pshift_8 = ShiftPaths(Data=align.Plane, Offset=-1)
lng_3 = ListLength(List=flatten(unroller.Brep))  # -> expr("x-1", Length)
lng_4 = ListLength(List=flatten(unroller_2.Brep))  # -> expr("x-1", Length)
dam_3 = DataDam(DataA=merge_4, BufferDelay=10000000, BufferMode=0)

# ----
# connection frames
cull_i_4 = CullIndex(List=pshift_7, Indices=0, Wrap=True)
cull_i_5 = CullIndex(List=pshift_8, Indices=0, Wrap=True)

align_3 = AlignPlane(Plane=pframe_4, Direction=Z_7)  # -> Plane, Angle
align_4 = AlignPlane(Plane=pframe_3, Direction=Z_7)  # -> Plane, Angle
range_4 = Range(Domain=Slider(1252.48, range=0..1500), Steps=lng_3)  # -> graft(Range)
range_5 = Range(Domain=Slider(1139.98, range=0..1500), Steps=lng_4)  # -> graft(Range)
Y = UnitY(Factor=Slider(579.459, range=0..1500))
X = UnitX(Factor=range_5)
X_2 = UnitX(Factor=range_4)
sec = BrepPlane(Brep=graft(dam_3), Plane=flatten(cull_i_5))  # -> Curves, Points; disabled
addition = Addition(A=X_2, B=Y)
move_5 = Move(Geometry=unroller_2.Brep, Motion=X)  # -> Geometry, Transform
move_6 = Move(Geometry=unroller.Brep, Motion=addition)  # -> Geometry, Transform

resolution = Slider(190, range=2..200)
divide_10 = DivideCurve(Curve=intcrv_5.Curve, Count=resolution, Kinks=False)  # -> Points, Tangents, Parameters
Z_8 = UnitZ(Factor=1)
divide_11 = DivideCurve(Curve=intcrv_6.Curve, Count=resolution, Kinks=False)  # -> Points, Tangents, Parameters
line_3 = LineSDL(Start=divide_10.Points, Direction=Z_8, Length=1)
srf_3 = Surface([merge_4, merge_3])
join = BrepJoin(Breps=flatten(loft))  # -> Breps, Closed
area = Area(Geometry=flatten(srf_3))  # -> Area, Centroid
line_4 = LineSDL(Start=divide_11.Points, Direction=Z_8, Length=1)
join_2 = BrepJoin(Breps=flatten(loft_6))  # -> Breps, Closed
blx = BrepLine(Brep=join.Breps, Line=line_3, LimitToFirst=False)  # -> Curves, Points
blx_2 = BrepLine(Brep=join_2.Breps, Line=line_4, LimitToFirst=False)  # -> Curves, Points
sheet_area_mq = Panel("0.7")
ma = MassAddition(Input=area.Area)  # -> Result, PartialResults
ln = Line(StartPoint=graft(divide_10.Points), EndPoint=blx.Points)
dist = Distance(PointA=graft(divide_10.Points), PointB=blx.Points)  # -> flatten(Distance)
# counts
dist_2 = Distance(PointA=graft(divide_11.Points), PointB=blx_2.Points)  # -> flatten(Distance)
ln_2 = Line(StartPoint=graft(divide_11.Points), EndPoint=blx_2.Points)
extremums = MinMax(Number=[dist_2, dist])  # -> Minimum, Maximum
min_max_depth_cm = Panel([extremums.Minimum, extremums.Maximum])

multiplication_6 = Multiplication(A=ma.Result, B=0.0001)

multiplication_7 = Multiplication(A=multiplication_6, B=2)
division_2 = Division(A=multiplication_7, B=sheet_area_mq)
# deviation
int_4 = Integer(division_2)
total_area_sqm = Panel(multiplication_6)
n_of_sheets = Panel(int_4)

area_2 = Area(Geometry=flatten(merge_3))  # -> Area, Centroid
area_3 = Area(Geometry=flatten(unroller.Brep))  # -> Area, Centroid
area_4 = Area(Geometry=flatten(merge_4))  # -> Area, Centroid
area_5 = Area(Geometry=flatten(unroller_2.Brep))  # -> Area, Centroid
subtraction_3 = Subtraction(A=area_2.Area, B=area_3.Area)
lng_5 = ListLength(List=area_2.Centroid)
subtraction_4 = Subtraction(A=area_4.Area, B=area_5.Area)
lng_6 = ListLength(List=area_4.Centroid)
series = Series(Start=0, Step=1, Count=lng_5)
abs = Absolute(Value=subtraction_3)
abs_2 = Absolute(Value=subtraction_4)
series_2 = Series(Start=0, Step=1, Count=lng_6)
division_3 = Division(A=abs, B=area_2.Area)
division_4 = Division(A=abs_2, B=area_4.Area)
multiplication_8 = Multiplication(A=division_3, B=100)
multiplication_9 = Multiplication(A=division_4, B=100)
panel_3 = Panel(multiplication_9)
panel_4 = Panel(multiplication_8)
tag = TextTag3D(Location=area_2.Centroid, Text=series, Size=Slider(2.399, range=0..100), Justification=7)
tag_2 = TextTag3D(Location=area_4.Centroid, Text=series_2, Size=Slider(2.399, range=0..100), Justification=7)
bar_graph_3 = BarGraph(multiplication_9, BarColor=RGB(255, 0, 90))
bar_graph_4 = BarGraph(multiplication_8, BarColor=RGB(255, 0, 90))

bnd_3 = Bounds(Numbers=[subtraction_3, subtraction_4])

remap_3 = RemapNumbers(Value=subtraction_3, Source=bnd_3, Target=Domain(0, 1))  # -> Mapped, Clipped
remap_4 = RemapNumbers(Value=subtraction_4, Source=bnd_3, Target=Domain(0, 1))  # -> Mapped, Clipped
gradient = Gradient(LowerLimit=0, UpperLimit=1, Parameter=remap_3.Mapped, stops=[0: RGB(255, 0, 0), 1: RGB(255, 255, 255)])
gradient_2 = Gradient(LowerLimit=0, UpperLimit=1, Parameter=remap_4.Mapped, stops=[0: RGB(255, 0, 0), 1: RGB(255, 255, 255)])
previewmat_3 = CustomPreviewMaterials(Geometry=flatten(merge_4), DiffuseColor=gradient_2)
previewmat_4 = CustomPreviewMaterials(Geometry=flatten(merge_3), DiffuseColor=gradient)
